# Grasshopper definition report01_test.gh (Grasshopper 1.0.7)
# plug-ins: GrasshopperPRT

path = FilePath("C:\Users\lor11212\Documents\Rhino\rhino-plugin-prototype\TestCases\reporting_04.rpk")
crv = Curve(<curve referenced from the Rhino model>)
rec = Rectangle([{Plane=PlaneXY(40, -29.5, 0), Size=Domain2(u=-11..11, v=-13.5..13.5)}, {Plane=PlaneXY(41.5, 17.5, 0), Size=Domain2(u=-6.5..6.5, v=-19.5..19.5)}, {Plane=PlaneXY(18, 52.5, 0), Size=Domain2(u=-6..6, v=-13.5..13.5)}, {Plane=PlaneXY(0, -22.5, 0), Size=Domain2(u=-9..9, v=-13.5..13.5)}, {Plane=PlaneXY(-4.5, 18, 0), Size=Domain2(u=-12.5..12.5, v=-17..17)}, {Plane=PlaneXY(-47, 27.5, 0), Size=Domain2(u=-12..12, v=-18.5..18.5)}, {Plane=PlaneXY(-31.5, -27, 0), Size=Domain2(u=-8.5..8.5, v=-19..19)}])
ghprt = GrasshopperPRT(PathToRPK=path, InitialShapes=[crv, rec])  # -> GeneratedShapes, AreaBuildUp_avg, AreaBuildUp_max, AreaBuildUp_min, AreaBuildUp_n, AreaBuildUp_sum, FAR_avg, FAR_max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
panel = Panel(ghprt.FAR_n)
panel_2 = Panel(ghprt.GFAResidential_min)
